# Grasshopper definition BlockTests.gh (Grasshopper 1.0.7)

genes = GenePool(Decimals=3, Maximum=1, Minimum=0, Value=[0.294, 0.783])
python = GhPythonScript(homeNodes=Button(), blockName="Linear_Base", subBlock="Linear_Glide")  # -> out, a, b, c; inputs homeNodes: Boolean
# ---------- python: Python ----------
__author__ = "tlogan"
__version__ = "2019.03.30"

import Rhino
import System
import Grasshopper.DataTree as DataTree
from Grasshopper.Kernel.Data import GH_Path
import scriptcontext as sc

class Node(object):
    def __init__(self):
        self.block = None
        self.location = None
        self.xform = None
        self.geo = None
        self.id = None
        self.travel = None
        self.sub_block = None
        self.sub_location = None
        self.sub_xform = None
        self.sub_geo = None
        self.sub_traveled = None
    
    def __str__(self):
        s = "Name: " + self.block.InstanceDefinition.Name
        s += "\nLoc: "  + str(self.location)
        s += "\nXForm: " + str(self.xform)
        s += "\nID: " + self.id
        s += "\nTravel: " + str(self.travel)
        s += "\nSubName: " + self.sub_block.InstanceDefinition.Name
        s += "\nSubLoc: " + str(self.sub_location)
        s += "\nSubXForm: " + str(self.sub_xform)
        s += "\nSubTraveled: " + str(self.sub_traveled)
        return s

# Get the Rhino Document and find all Block Instances
rDoc = Rhino.RhinoDoc.ActiveDoc
rObjs = rDoc.Objects.FindByObjectType(Rhino.DocObjects.ObjectType.InstanceReference)

nodes = []
nodeStrs = []
for ro in rObjs:
    if ro.InstanceDefinition.Name == blockName:
        node = Node()
        node.block = ro
        idx = System.Array.IndexOf(ro.Attributes.GetUserStrings().AllKeys, "NodeID")
        if idx >= 0:
            node.id = ro.Attributes.GetUserStrings().Get(idx)
        else:
            node.id = None
        idx = System.Array.IndexOf(ro.Attributes.GetUserStrings().AllKeys, "Travel")
        if idx >= 0:
            node.travel = float(ro.Attributes.GetUserStrings().Get(idx))
        else:
            node.travel = 0.0
        node.location = ro.InsertionPoint
        node.xform = ro.InstanceXform
        
        # The Rhino.DocObjects.InstanceObject.Explode() method outputs:
        #    0: RhinoObject[] pieces
        #    1: ObjectAttributes[] pieceAttributes
        #    2: Transform[] pieceTransforms
        expl = ro.Explode(True)
        geom = []
        for i in range(len(expl[0])):
            piece = expl[0][i]
            geo = piece.Geometry
            if type(geo) is Rhino.Geometry.Brep or type(geo) is Rhino.Geometry.Extrusion:
                geo.Transform(expl[2][i])
                geom.append(geo)
        node.geo = geom
        nodes.Add(node)

for ro in rObjs:
    if ro.InstanceDefinition.Name != subBlock:
        continue
    id = None
    
    idx = System.Array.IndexOf(ro.Attributes.GetUserStrings().AllKeys, "NodeID")
    if idx >= 0:
        id = ro.Attributes.GetUserStrings().Get(idx)
    if id == None:
        continue
    # find the branch with the primary block
    branch_idx = -1
    for i in range(len(nodes)):
        n = nodes[i]
        if n.id == id:
            branch_idx = i
            break
    if branch_idx == -1:
        continue
    
    expl = ro.Explode(True)
    geom = []
    for i in range(len(expl[0])):
        piece = expl[0][i]
        geo = piece.Geometry
        if type(geo) is Rhino.Geometry.Brep or type(geo) is Rhino.Geometry.Extrusion:
            geo.Transform(expl[2][i])
            geom.append(geo)
    # Reset the Transform
    invert = ro.InstanceXform.TryGetInverse()
    xform = None
    if invert[0]:
        xform = nodes[branch_idx].xform * invert[1]
    else:
        xform = nodes[branch_idx].xform
    if homeNodes:
        rDoc.Objects.Transform(ro, xform, True)
    nodes[branch_idx].sub_traveled = 0.0
    nodes[branch_idx].sub_block = ro
    nodes[branch_idx].sub_location = ro.InsertionPoint
    nodes[branch_idx].sub_xform = ro.InstanceXform
    nodes[branch_idx].sub_geo = geom
    n = nodes[branch_idx]
    nodeStrs.append(str(nodes[branch_idx]))
    
nodes.sort(key=lambda n: n.id, reverse=False)
a = nodeStrs
sc.sticky["meca_nodes"] = nodes
# ---------- end python ----------
python_2 = GhPythonScript(nodes=python.a, travel=genes)  # -> out, a, b; inputs nodes: list, travel: list
# ---------- python_2: Python ----------
__author__ = "tlogan"
__version__ = "2019.03.30"

import Rhino
import Rhino.Geometry as rg
import scriptcontext as sc

rdoc = Rhino.RhinoDoc.ActiveDoc

vecs = []
nodes = sc.sticky["meca_nodes"]
for i,n in enumerate(nodes): # type: rg.Transform
    x = n.xform
    v = rg.Vector3d(x.M00, -x.M01, x.M02)
    v.Unitize()
    # move location
    pct = 0.0
    if i < len(travel):
        pct = travel[i]
    else:
        pct = travel[-1]
    dist = n.travel * pct
    
    if dist != n.sub_traveled:
        
        delta = dist - n.sub_traveled
        v = v *delta
        trans = rg.Transform.Translation(v)
        rdoc.Objects.Transform(n.sub_block, trans, True)
        sc.sticky["meca_nodes"][i].sub_traveled = dist
    print "traveled: " + str(n.sub_traveled) + "\ndist: " + str(dist)
sc.sticky["meca_nodes"] = nodes
# ---------- end python_2 ----------
panel = Panel(python_2.out)
