# Grasshopper definition moveMachine.gh (Grasshopper 1.0.7)

createmachine = GhPythonScript(name="nadya")  # -> out, machineObject
# ---------- createmachine: Python ----------
# Example machine for testing importing into Rhino
# Nadya for Brian, 2019

#------IMPORTS-------
from pygestalt import nodes
from pygestalt import interfaces
from pygestalt import machines
from pygestalt import functions
from pygestalt.machines import elements
from pygestalt.machines import kinematics
from pygestalt.machines import state
from pygestalt.utilities import notice
import time
import io
import scriptcontext


#------VIRTUAL MACHINE------
# here we describe the kinematics of our machine
# this one uses two direct drive stages with 8mm leadscrews for both X and Y

"""
def initControllers(self):
self.xAxisNode = nodes.networkedGestaltNode('X Axis', self.fabnet, filename = 'module_086_005a.py', persistence = self.persistence)
self.yAxisNode = nodes.networkedGestaltNode('Y Axis', self.fabnet, filename = 'module_086_005a.py', persistence = self.persistence)

self.xyNode = nodes.compoundNode(self.xAxisNode, self.yAxisNode)
"""


class virtualMachine(machines.virtualMachine):

    def initInterfaces(self):
        if self.providedInterface: self.fabnet = self.providedInterface		#providedInterface is defined in the virtualMachine class.
        else: self.fabnet = interfaces.gestaltInterface('FABNET', interfaces.serialInterface(baudRate = 115200, interfaceType = 'ftdi', portName = 'COM6'))
    
    def initControllers(self):
        pass
        
    def initCoordinates(self):
        self.position = state.coordinate(['mm', 'mm'])

    def initKinematics(self):
        #each stage uses a microstepping controller with 4 subdivisions per step. The step angle is 1.8 degrees. The 4 start lead screw has a pitch of 2mm, so one full rotation results in 8mm of travel
        self.xAxis = elements.elementChain.forward([elements.microstep.forward(4), elements.stepper.forward(1.8), elements.leadscrew.forward(8), elements.invert.forward(True)])
        self.yAxis = elements.elementChain.forward([elements.microstep.forward(4), elements.stepper.forward(1.8), elements.leadscrew.forward(8), elements.invert.forward(False)])
        self.stageKinematics = kinematics.direct(2)	#direct drive on all axes

    def initFunctions(self):
        """
        #move is the only function we have really implemented for this machine
        self.move = functions.move(virtualMachine = self, virtualNode = self.xyNode, axes = [self.xAxis, self.yAxis], kinematics = self.stageKinematics, machinePosition = self.position,planner = 'null')
        self.jog = functions.jog(self.move)	#an incremental wrapper for the move function
        """
        pass

    def initLast(self):
        #self.machineControl.setMotorCurrents(aCurrent = 0.8, bCurrent = 0.8, cCurrent = 0.8)
        #self.xNode.setVelocityRequest(0)	#clear velocity on nodes. Eventually this will be put in the motion planner on initialization to match state.
        pass

    def publish(self):
        #self.publisher.addNodes(self.machineControl)
        pass

    def getPosition(self):
        return {'position':self.position.future()}

    def setPosition(self, position  = [None]):
        self.position.future.set(position)

    def setSpindleSpeed(self, speedFraction):
        #self.machineControl.pwmRequest(speedFraction)
        pass

#----end of virtual machine description------#
if not name:
    name = 'machine'

machineObject=scriptcontext.sticky.get(name)
#------using the virtual machine------
if not machineObject:
    # The persistence file remembers the node you set.
    # It'll generate the first time you run the
    # nodes. If you are hooking up a new node, delete
    # the previous persistence file. So I guess we need write access?
    import os
    os.chdir("c:\dev")

    machineObject = virtualMachine(persistenceFile = "{0}.vmp".format(name), name=name)
    scriptcontext.sticky[name] = machineObject
# ---------- end createmachine ----------
list = ValueList({"X": 0, "Y": 1, "Z": 2}, selected="X")
list_2 = ValueList({"X": 0, "Y": 1, "Z": 2}, selected="Y")
createmachine_2 = GhPythonScript(name="nadya")  # -> out, machineObject; disabled
# ---------- createmachine_2: Python ----------
# Example machine for testing importing into Rhino
# Nadya for Brian, 2019

#------IMPORTS-------
from pygestalt import nodes
from pygestalt import interfaces
from pygestalt import machines
from pygestalt import functions
from pygestalt.machines import elements
from pygestalt.machines import kinematics
from pygestalt.machines import state
from pygestalt.utilities import notice
import time
import io
import scriptcontext


#------VIRTUAL MACHINE------
# here we describe the kinematics of our machine
# this one uses two direct drive stages with 8mm leadscrews for both X and Y

class virtualMachine(machines.virtualMachine):

	def initInterfaces(self):
		if self.providedInterface: self.fabnet = self.providedInterface		#providedInterface is defined in the virtualMachine class.
		else: self.fabnet = interfaces.gestaltInterface('FABNET', interfaces.serialInterface(baudRate = 115200, interfaceType = 'ftdi', portName = 'COM6'))

	def initControllers(self):
		self.xAxisNode = nodes.networkedGestaltNode('X Axis', self.fabnet, filename = 'module_086_005a.py', persistence = self.persistence)
		self.yAxisNode = nodes.networkedGestaltNode('Y Axis', self.fabnet, filename = 'module_086_005a.py', persistence = self.persistence)

		self.xyNode = nodes.compoundNode(self.xAxisNode, self.yAxisNode)

	def initCoordinates(self):
		self.position = state.coordinate(['mm', 'mm'])

	def initKinematics(self):
        #each stage uses a microstepping controller with 4 subdivisions per step. The step angle is 1.8 degrees. The 4 start lead screw has a pitch of 2mm, so one full rotation results in 8mm of travel
		self.xAxis = elements.elementChain.forward([elements.microstep.forward(4), elements.stepper.forward(1.8), elements.leadscrew.forward(8), elements.invert.forward(True)])
		self.yAxis = elements.elementChain.forward([elements.microstep.forward(4), elements.stepper.forward(1.8), elements.leadscrew.forward(8), elements.invert.forward(False)])
		self.stageKinematics = kinematics.direct(2)	#direct drive on all axes

	def initFunctions(self):
        #move is the only function we have really implemented for this machine
		self.move = functions.move(virtualMachine = self, virtualNode = self.xyNode, axes = [self.xAxis, self.yAxis], kinematics = self.stageKinematics, machinePosition = self.position,planner = 'null')
		self.jog = functions.jog(self.move)	#an incremental wrapper for the move function
		pass

	def initLast(self):
		#self.machineControl.setMotorCurrents(aCurrent = 0.8, bCurrent = 0.8, cCurrent = 0.8)
		#self.xNode.setVelocityRequest(0)	#clear velocity on nodes. Eventually this will be put in the motion planner on initialization to match state.
		pass

	def publish(self):
		#self.publisher.addNodes(self.machineControl)
		pass

	def getPosition(self):
		return {'position':self.position.future()}

	def setPosition(self, position  = [None]):
		self.position.future.set(position)

	def setSpindleSpeed(self, speedFraction):
		#self.machineControl.pwmRequest(speedFraction)
		pass

#----end of virtual machine description------#
if not name:
    name = 'machine'

machineObject=scriptcontext.sticky.get(name)
#------using the virtual machine------
if not machineObject:
	# The persistence file remembers the node you set.
    # It'll generate the first time you run the
	# nodes. If you are hooking up a new node, delete
    # the previous persistence file. So I guess we need write access?
    import os
    os.chdir("c:\dev")

    machineObject = virtualMachine(persistenceFile = "{0}.vmp".format(name), name=name)
    scriptcontext.sticky[name] = machineObject
# ---------- end createmachine_2 ----------
node = GhPythonScript(
    machineObject=createmachine.machineObject,
    name="y axis",
    type=list_2,
    min=Slider(0, range=0..100),
    max=Slider(88, range=0..100),
    identify=Toggle(False))  # -> out, node; inputs type: Int32, identify: tree of Boolean
# ---------- node: Python ----------
__author__ = "nadya"
__version__ = "2019.03.30"

import rhinoscriptsyntax as rs
from pygestalt import nodes
from pygestalt import interfaces
from pygestalt import machines
from pygestalt import functions
from pygestalt.machines import elements
from pygestalt.machines import kinematics
from pygestalt.machines import state
from pygestalt.utilities import notice
import time
import io
import scriptcontext

_node = None

if not name:
    name = 'node'

_node = scriptcontext.sticky.get(name)

if not _node:
    if identify:
        _node = nodes.networkedGestaltNode(name, machineObject.fabnet, filename = 'module_086_005a.py', persistence = machineObject.persistence)
        _node.axisType = type
        _node.minVal = min
        _node.maxVal = max
        scriptcontext.sticky[name] = _node
node = _node
# ---------- end node ----------
node_2 = GhPythonScript(
    machineObject=createmachine.machineObject,
    name="x axis",
    type=list,
    min=Slider(0, range=0..100),
    max=Slider(62, range=0..100),
    identify=Toggle(False))  # -> out, node; inputs type: Int32, identify: tree of Boolean; same code as node
pt = ConstructPoint(XCoordinate=Slider(138, range=0..300), YCoordinate=Slider(9.7, range=0..20), ZCoordinate=0)  # disabled
pt_2 = ConstructPoint(XCoordinate=Slider(138, range=0..300), YCoordinate=Slider(9.7, range=0..20), ZCoordinate=0)
movemachine = GhPythonScript(run=Toggle(False), machineObject=createmachine_2.machineObject, pts=pt)  # -> out, a; inputs run: Boolean, pts: list of Point3d; disabled
# ---------- movemachine: Python ----------
import time
# This is for how fast the motors will move
machineObject.xyNode.setVelocityRequest(8)

# Some random moves to test, in the future maybe these can come from GH!
#moves = [[10,10],[20,20],[10,10],[0,0]]

moves = []
for pt in pts:
    move = [pt.X, pt.Y]
    moves.append(move)

# Move!
for move in moves:
    machineObject.move(move, 0)
    status = machineObject.xAxisNode.spinStatusRequest()
    # This checks to see if the move is done. Because the nodes in the
    # compoundnode are synced, you only need to check one. We are checking X
    while status['stepsRemaining'] > 0:
        time.sleep(0.001)
        status = machineObject.xAxisNode.spinStatusRequest()
# machineObject.fabnet.disconnect()
# ---------- end movemachine ----------
merge = Merge(Data1=node_2.node, Data2=node.node)
movemachine_2 = GhPythonScript(run=Toggle(False), machineObject=createmachine.machineObject, nodes=merge, pts=pt_2)  # -> out, a; inputs run: Boolean, nodes: list, pts: list of Point3d
# ---------- movemachine_2: Python ----------
import time


# Some random moves to test, in the future maybe these can come from GH!
#moves = [[10,10],[20,20],[10,10],[0,0]]

machineObject.xyNode = machineObject.compoundNode(nodes)



machineObject.move = functions.move(virtualMachine = machineObject, virtualNode = machineObject.xyNode, axes = nodes, kinematics = machineObject.stageKinematics, machinePosition = machineObject.position,planner = 'null')
machineObject.jog = functions.jog(machineObject.move)	#an incremental wrapper for the move function


# This is for how fast the motors will move
machineObject.xyNode.setVelocityRequest(8)

moves = []
for pt in pts:
    move = [pt.X, pt.Y]
    moves.append(move)



# Move!
for move in moves:
    machineObject.move(move, 0)
    status = machineObject.xAxisNode.spinStatusRequest()
    # This checks to see if the move is done. Because the nodes in the
    # compoundnode are synced, you only need to check one. We are checking X
    while status['stepsRemaining'] > 0:
        time.sleep(0.001)
        status = machineObject.xAxisNode.spinStatusRequest()
# machineObject.fabnet.disconnect()
# ---------- end movemachine_2 ----------
